# Dynamo graph Paraboloide_Midi.dyn (Dynamo 2.17.1.4055)

zero = TimeSpan.Zero()
now = DateTime.Now()
timeOfDay = DateTime.TimeOfDay(dateTime=now)
add = TimeSpan.Add(timeSpan1=zero, timeSpan2=timeOfDay)
revit_uia = Python(IN[0]=add)  # CPython3
# ---------- revit_uia.python (20 lines) ----------
import clr
import Revit

clr.AddReference("ProtoGeometry")
clr.AddReference("RevitAPI")
clr.AddReference("RevitAPIUI")
clr.AddReference("RevitServices")
clr.AddReference("RevitNodes")

from Autodesk.DesignScript.Geometry import *
from Autodesk.Revit.DB import *
from RevitServices.Persistence import DocumentManager


dad = IN[0]

doc = DocumentManager.Instance.CurrentDBDocument
uia = DocumentManager.Instance.CurrentUIApplication

OUT = uia
# ----------------------------------------
code_block = CodeBlock { 0; }
MIDI_Ativar = Musica_2020.Musica_2020.MIDI_Ativar(n=code_block)
toca_paraboloide = CodeBlock(rvuia=revit_uia, tempo=add, midi=MIDI_Ativar)
# ---------- toca_paraboloide.designscript (43 lines) ----------
rvuia;
tempo;
midi;
//---------------------------------------------------------
// Converte em string o Tempo Atual e separa segs e mils
// Configurar o período compatível com a duração
//---------------------------------------------------------
max   = 12;
pulso = 12500;
mili  = String.Substring ( tempo+"" , 9 , 3);
s     = (String.ToNumber ( mili ) % max )+max;
s1    = (s%5? s*1.01 : s%4? s*0.15 : s%3? s*1.5 : s*1);
s2    = (s%5? s*0.50 : s%4? s*1.02 : s%3? s*0.4 : s*1);
x     = (0..max) * s1;
y     = (0..max) * s1;
z1    = (0..max) * s/2;
z2    = (max..0) * s/2;
pt    = Point.ByCoordinates ( x<1> , y , 0);
i     = 0..s-1;
j     = i+1;
p1    = pt[ 0].Translate    ( 0 , 0 , z1);
p2    = pt[-1].Translate    ( 0 , 0 , z2);
pp    = Line.DivideEqually  ( g1  ,  max).StartPoint;

g1   = Line.ByStartPointEndPoint ( p1    , p2);
g2   = Line.ByStartPointEndPoint ( p1[i] , p1[j]);
g3   = Line.ByStartPointEndPoint ( p2[i] , p2[j]);
g4   = Line.ByStartPointEndPoint ( pp[i] , pp[j]);

pts  = List.Flatten([p2, pp , p1] , 2);
mel  = [ 0, 2, 4, 5, 0, 7, 9, 10, 12, -2, -1, 0] + s%3;
rit  = [ 1.50, 1.50, 1.50];
//---------------------------------------------------------
// Se aumentar a dur deve aumentar o período para que possa
// completar o ciclo
//---------------------------------------------------------
f    = s%2? 60 : 64;
m    = List.Count ( mel   )-1;
r    = List.Count ( rit   )-1;
a    = Math.Floor ( pts.Z ) %m;
t    = Math.Floor ( pts.Z ) %r;
sal  = List.ShiftIndices(mel, s%4)[a];
dur  = Math.Floor ( pulso / (Math.Pow( s+1 , rit[t])));
# ----------------------------------------
tocar = CodeBlock(midi=toca_paraboloide.midi, f=toca_paraboloide.f, sal=toca_paraboloide.sal, dur=toca_paraboloide.dur) { midi; Musica_2020.Tocar_Nota( midi, f, sal, dur, 120, 1, 9, 1); }
